test file "HeliLoopTest"

suite "Helicopter Pitch Control Test"

  case "SmallPositiveStep1" [simulation]
    description: Pitch step of +1 degree to determine tracking, overshoot and rise time.
    model HelicopterSystem, stop time 10
    post-load callback:
      t=0:0.01:10;
      p=zeros(1,1001);
      p(1,101:1001)=1;
      r=zeros(1,1001);
      y=zeros(1,1001);
      input.CyclicPitch = timeseries(p,t);
      input.CyclicRoll = timeseries(r,t);
      input.Pedal = timeseries(y,t);
    cleanup callback:
      clearvars t p r y input;
      bdclose all;
    custom criteria:
      % Get output signal
      out = test.sltest_simout.get('logsout').get('ahrs').Values.theta.Data;

      % Verify rise time is 2 +/-0.5 sec, 63% of final value by 2.5 sec
      riseData = out(351:end);
      threshold = 0.63*1.0;
      test.verifyGreaterThanOrEqual(min(riseData), threshold);

      % Verify maximum overshoot is 10%
      peakData = out(101:end);
      threshold = 1.1*1.0;
      test.verifyLessThanOrEqual(max(peakData), threshold);

      % Verify final tracking is within 5% of 1.0
      % Settling time should occur within 6 sec after the step
      % assuming 2 sec rise time (1 + 6)
      settledData = out(701:end);
      threshold = 0.05*1.0;
      test.verifyGreaterThanOrEqual(min(settledData), 1.0-threshold);
      test.verifyLessThanOrEqual(max(settledData), 1.0+threshold);

  case "SmallNegativeStep1" [simulation]
    description: Pitch step of -1 degree to determine tracking, overshoot and rise time.
    model HelicopterSystem, stop time 10
    post-load callback:
      t=0:0.01:10;
      p=zeros(1,1001);
      p(1,101:1001)=-1;
      r=zeros(1,1001);
      y=zeros(1,1001);
      input.CyclicPitch = timeseries(p,t);
      input.CyclicRoll = timeseries(r,t);
      input.Pedal = timeseries(y,t);
    cleanup callback:
      clearvars t p r y input;
      bdclose all;
    custom criteria:
      % Get output signal
      out = test.sltest_simout.get('logsout').get('ahrs').Values.theta.Data;

      % Verify rise time is 2 +/-0.5 sec, 63% of final value by 2.5 sec
      riseData = out(351:end);
      threshold = -0.63*1.0;
      test.verifyLessThanOrEqual(max(riseData), threshold);

      % Verify maximum overshoot is 10%
      peakData = out(101:end);
      threshold = -1.1*1.0;
      test.verifyGreaterThanOrEqual(min(peakData), threshold);

      % Verify final tracking is within 5% of 1.0
      % Settling time should occur within 6 sec after the step
      % assuming 2 sec rise time (1 + 6)
      settledData = out(701:end);
      threshold = 0.05*1.0;
      test.verifyGreaterThanOrEqual(min(settledData), -1-threshold);
      test.verifyLessThanOrEqual(max(settledData), -1+threshold);

suite "Helicopter Roll Control Test"

  case "SmallPositiveStep2" [simulation]
    description: Roll step of +1 degree to determine tracking, overshoot and rise time.
    model HelicopterSystem, stop time 10
    post-load callback:
      t=0:0.01:10;
      p=zeros(1,1001);
      r=zeros(1,1001);
      r(1,101:1001)=1;
      y=zeros(1,1001);
      input.CyclicPitch = timeseries(p,t);
      input.CyclicRoll = timeseries(r,t);
      input.Pedal = timeseries(y,t);
    cleanup callback:
      clearvars t p r y input;
      bdclose all;
    custom criteria:
      % Get output signal
      out = test.sltest_simout.get('logsout').get('ahrs').Values.phi.Data;

      % Verify rise time is 2 +/-0.5 sec, 63% of final value by 2.5 sec
      riseData = out(351:end);
      threshold = 0.63*1.0;
      test.verifyGreaterThanOrEqual(min(riseData), threshold);

      % Verify maximum overshoot is 10%
      peakData = out(101:end);
      threshold = 1.1*1.0;
      test.verifyLessThanOrEqual(max(peakData), threshold);

      % Verify final tracking is within 5% of 1.0
      % Settling time should occur within 6 sec after the step
      % assuming 2 sec rise time (1 + 6)
      settledData = out(701:end);
      threshold = 0.05*1.0;
      test.verifyGreaterThanOrEqual(min(settledData), 1.0-threshold);
      test.verifyLessThanOrEqual(max(settledData), 1.0+threshold);

  case "SmallNegativeStep2" [simulation]
    description: Roll step of -1 degree to determine tracking, overshoot and rise time.
    model HelicopterSystem, stop time 10
    post-load callback:
      t=0:0.01:10;
      p=zeros(1,1001);
      r=zeros(1,1001);
      r(1,101:1001)=-1;
      y=zeros(1,1001);
      input.CyclicPitch = timeseries(p,t);
      input.CyclicRoll = timeseries(r,t);
      input.Pedal = timeseries(y,t);
    cleanup callback:
      clearvars t p r y input;
      bdclose all;
    custom criteria:
      % Get output signal
      out = test.sltest_simout.get('logsout').get('ahrs').Values.phi.Data;

      % Verify rise time is 2 +/-0.5 sec, 63% of final value by 2.5 sec
      riseData = out(351:end);
      threshold = -0.63*1.0;
      test.verifyLessThanOrEqual(max(riseData), threshold);

      % Verify maximum overshoot is 10%
      peakData = out(101:end);
      threshold = -1.1*1.0;
      test.verifyGreaterThanOrEqual(min(peakData), threshold);

      % Verify final tracking is within 5% of 1.0
      % Settling time should occur within 6 sec after the step
      % assuming 2 sec rise time (1 + 6)
      settledData = out(701:end);
      threshold = 0.05*1.0;
      test.verifyGreaterThanOrEqual(min(settledData), -1-threshold);
      test.verifyLessThanOrEqual(max(settledData), -1+threshold);

suite "Helicopter Yaw Control Test"

  case "SmallPositiveStep3" [simulation]
    description: Yaw step of +1 degree/sec to determine tracking, overshoot and rise time.
    model HelicopterSystem, stop time 10
    post-load callback:
      t=0:0.01:10;
      p=zeros(1,1001);
      r=zeros(1,1001);
      y=zeros(1,1001);
      y(1,101:1001)=1;
      input.CyclicPitch = timeseries(p,t);
      input.CyclicRoll = timeseries(r,t);
      input.Pedal = timeseries(y,t);
    cleanup callback:
      clearvars t p r y input;
      bdclose all;
    custom criteria:
      % Get output signal
      out = test.sltest_simout.get('logsout').get('ahrs').Values.r.Data;

      % Verify rise time is 2 +/-0.5 sec, 63% of final value by 2.5 sec
      riseData = out(351:end);
      threshold = 0.63*1.0;
      test.verifyGreaterThanOrEqual(min(riseData), threshold);

      % Verify maximum overshoot is 10%
      peakData = out(101:end);
      threshold = 1.1*1.0;
      test.verifyLessThanOrEqual(max(peakData), threshold);

      % Verify final tracking is within 5% of 1.0
      % Settling time should occur within 6 sec after the step
      % assuming 2 sec rise time (1 + 6)
      settledData = out(701:end);
      threshold = 0.05*1.0;
      test.verifyGreaterThanOrEqual(min(settledData), 1.0-threshold);
      test.verifyLessThanOrEqual(max(settledData), 1.0+threshold);

  case "SmallNegativeStep3" [simulation]
    description: Yaw step of -1 degree/sec to determine tracking, overshoot and rise time.
    model HelicopterSystem, stop time 10
    post-load callback:
      t=0:0.01:10;
      p=zeros(1,1001);
      r=zeros(1,1001);
      y=zeros(1,1001);
      y(1,101:1001)=-1;
      input.CyclicPitch = timeseries(p,t);
      input.CyclicRoll = timeseries(r,t);
      input.Pedal = timeseries(y,t);
    cleanup callback:
      clearvars t p r y input;
      bdclose all;
    custom criteria:
      % Get output signal
      out = test.sltest_simout.get('logsout').get('ahrs').Values.r.Data;

      % Verify rise time is 2 +/-0.5 sec, 63% of final value by 2.5 sec
      riseData = out(351:end);
      threshold = -0.63*1.0;
      test.verifyLessThanOrEqual(max(riseData), threshold);

      % Verify maximum overshoot is 10%
      peakData = out(101:end);
      threshold = -1.1*1.0;
      test.verifyGreaterThanOrEqual(min(peakData), threshold);

      % Verify final tracking is within 5% of 1.0
      % Settling time should occur within 6 sec after the step
      % assuming 2 sec rise time (1 + 6)
      settledData = out(701:end);
      threshold = 0.05*1.0;
      test.verifyGreaterThanOrEqual(min(settledData), -1-threshold);
      test.verifyLessThanOrEqual(max(settledData), -1+threshold);