test file "Untitled"

suite "New Test Suite 1"

  case "New Test Case 1" [baseline]
    model HelicopterSystem, stop time 10
    post-load callback:
      t=0:0.01:10;
      p=zeros(1,1001);
      p(1,101:1001)=1;
      r=zeros(1,1001);
      y=zeros(1,1001);
      input.CyclicPitch = timeseries(p,t);
      input.CyclicRoll = timeseries(r,t);
      input.Pedal = timeseries(y,t);